# Grasshopper definition DH_ModifyLayout.gh (Grasshopper 1.0.8)
# plug-ins: DraftHorse

# ----
# Tools for automating layout creation and modification
# 
# By Jo Kamm
# https://github.com/jkamm/DraftHorse_gh
# DRAFTHORSE
# Example: Modify Layout Attributes
# 1. Create a Generic Layout
newlayout = CreateNewLayout(Height=11, Width=17, Details=4, Scale=1, Units=0)

# ----
# 2. Write to some or all Layout Attributes
number_slider = Slider(20, range=0..100)
values_length_must_match_keys = Panel("""Value1
Value2""")
layout = PageLayout(newlayout)
keys = Panel("""Key1
Key2""")
layoutedit = EditLayout(
    LayoutPage=layout,
    Name="NewLayoutName",
    Width=Slider(20, range=0..100),
    Height=number_slider,
    Keys=keys,
    Values=values_length_must_match_keys)  # -> LayoutPage, Index, Name, Width, Height, Keys, Values
keys_2 = Panel([layoutedit.LayoutPage, layoutedit.Index, layoutedit.Name, layoutedit.Width, layoutedit.Height, layoutedit.Values, layoutedit.Keys])
